% Simulink data dictionary architectureDD.sldd

ACE9C_ACE8x_9C = Simulink.Bus()
  ACE9C_ACE8x_GEARING_APPLIED: single
  ACE9C_ACE8x_GEARING_APP_F_C: boolean
  ACE9C_ACE8x_PPROG: uint8
  ACE9C_ACE8x_PPROG_FAILURE: boolean
  ACE9C_ACE8x_RAM_POS_C_FAILURE: boolean
  ACE9C_ACE8x_RAM_POS_C: single
  ACE9C_ACE8x_MODE_C: uint8
  ACE9C_ACE8x_ROLL_POS_C_FAILURE: boolean
  ACE9C_ACE8x_ROLL_POS_C: single
  ACE9C_ACE8x_INC_DEMAND_FAIL: boolean
  ACE9C_ACE8x_TBI_FLAG_APP: boolean
  ACE9C_ACE8x_SPD_C_FAILURE: boolean
  ACE9C_ACE8x_DELTA_P_FAILURE: boolean
  ACE9C_ACE8x_DELTA_P_C: single
  ACE9C_ACE8x_WOW1_C: boolean
  ACE9C_ACE8x_WOW2C: boolean
  ACE9C_ACE8x_SPD_C: uint8

ACE11C_ACE10x_11C = Simulink.Bus()
  ACE11C_ACE10x_GEARING_APPLIED: single
  ACE11C_ACE10x_GEARING_APP_F_C: boolean
  ACE11C_ACE10x_PPROG: uint8
  ACE11C_ACE10x_PPROG_FAILURE: boolean
  ACE11C_ACE10x_RAM_POS_C_FAILURE: boolean
  ACE11C_ACE10x_RAM_POS_C: single
  ACE11C_ACE10x_MODE_C: uint8
  ACE11C_ACE10x_ROLL_POS_C_FAILURE: boolean
  ACE11C_ACE10x_ROLL_POS_C: single
  ACE11C_ACE10x_INC_DEMAND_FAIL: boolean
  ACE11C_ACE10x_TBI_FLAG_APP: boolean
  ACE11C_ACE10x_SPD_C_FAILURE: boolean
  ACE11C_ACE10x_DELTA_P_FAILURE: boolean
  ACE11C_ACE10x_DELTA_P_C: single
  ACE11C_ACE10x_WOW1_C: boolean
  ACE11C_ACE10x_WOW2C: boolean
  ACE11C_ACE10x_SPD_C: uint8

FCC1_ACExxxA_C1_A = Simulink.Bus()
  FCC1_ACExxxA_GEARING_ROLL: single
  FCC1_ACExxxA_GEARING_ROLL_FAIL: boolean
  FCC1_ACExxxA_ROLL_INCREMENTAL_DEM_FAIL: boolean
  FCC1_ACExxxA_TBI_FAIL: boolean
  FCC1_ACExxxA_WHEEL_POS_1_FAIL: boolean
  FCC1_ACExxxA_SUR_POS_1_AIL_FAIL: boolean
  FCC1_ACExxxA_TBI_LH: single
  FCC1_ACExxxA_ROLL_INCREMENTAL_DEM_LH: single
  FCC1_ACExxxA_TBI_RH: single
  FCC1_ACExxxA_WHEEL_POS_1: single
  FCC1_ACExxxA_SUR_POS_1_AIL: single
  FCC1_ACExxxA_ROLL_INCREMENTAL_DEM_RH: single

FCC2_ACExxxA_M_A = Simulink.Bus()
  FCC2_ACExxxA_SUR_POS_2_AIL_FAIL: boolean
  FCC2_ACExxxA_SUR_POS_2_AIL: single
  FCC2_ACExxxA_GEARING_ROLL_HB: boolean
  FCC2_ACExxxA_TBI_HB: boolean
  FCC2_ACExxxA_TBI_INCREMENTAL_DEM_HB: boolean
  FCC2_ACExxxA_WHEEL_POS_2_FAIL: boolean
  FCC2_ACExxxA_BUCU4_ACT: boolean
  FCC2_ACExxxA_COL_POS_2_AIL_FAIL: boolean
  FCC2_ACExxxA_WHEEL_POS_2: single